# Grasshopper definition hex-clip-1.gh (Grasshopper 1.0.7)

number_slider = Slider(5, range=0..10)
number_slider_2 = Slider(14, range=0..100)
number_slider_3 = Slider(13, range=10..30)
number_slider_4 = Slider(7, range=0..10)
number_slider_5 = Slider(2, range=0..10)
expression = Expression(x=number_slider, Expression="{0, -x/2}")
cone = Cone(Base=PlaneXY(0, 0, 0), Radius=expr("x-2", number_slider_3), Length=Slider(28, range=5..30))  # -> Cone, Tip
polygon = Polygon(Plane=PlaneXY(0, 0, 0), Radius=number_slider_3, Segments=6, FilletRadius=0)  # -> Polygon, Length
vec = VectorXYZ(XComponent=0, YComponent=0, ZComponent=number_slider_5)  # -> Vector, Length
cyl = Cylinder(Base=PlaneXY(0, 0, 0), Radius=number_slider_3, Length=number_slider_2)
cyl_2 = Cylinder(Base=PlaneXY(0, 0, 0), Radius=number_slider_4, Length=number_slider_2)
xy = XYPlane(Origin=expression)
extr = Extrude(Base=polygon.Polygon, Direction=vec.Vector)
vec_2 = VectorXYZ(XComponent=0, YComponent=0, ZComponent=number_slider_4)  # -> Vector, Length
vec_3 = VectorXYZ(XComponent=0, YComponent=0, ZComponent=number_slider_5)  # -> Vector, Length
rectangle = Rectangle(Plane=xy, XSize=Slider(15, range=0..20), YSize=number_slider, Radius=0)  # -> Rectangle, Length
move = Move(Geometry=cyl, Motion=vec_2.Vector)  # -> Geometry, Transform
cap = CapHoles(Brep=extr)
move_2 = Move(Geometry=rectangle.Rectangle, Motion=vec_3.Vector)  # -> Geometry, Transform
cap_2 = CapHoles(Brep=move.Geometry)
arrpolar = PolarArray(Geometry=move_2.Geometry, Plane=PlaneXY(0, 0, 0), Count=3, Angle=6.283185307)  # -> Geometry, Transform
extr_2 = Extrude(Base=arrpolar.Geometry, Direction=vec_2.Vector)
sdiff = SolidDifference(BrepsA=cone.Cone, BrepsB=[cyl_2, cap_2])
cap_3 = CapHoles(Brep=extr_2)
sunion = SolidUnion(Breps=cap_3)
sunion_2 = SolidUnion(Breps=[cap, sdiff])
sdiff_2 = SolidDifference(BrepsA=sunion_2, BrepsB=sunion)
