# Grasshopper definition hex-clip-2.gh (Grasshopper 1.0.7)

number_slider = Slider(2, range=0..10)
number_slider_2 = Slider(5, range=0..10)
number_slider_3 = Slider(0, range=0..10)
crv = Curve(<curve referenced from the Rhino model>)
crv_2 = Curve(<curve referenced from the Rhino model>)
subtraction = Subtraction(A=number_slider_2, B=number_slider)
vec = VectorXYZ(XComponent=0, YComponent=Slider(1, range=0..10), ZComponent=0)  # -> Vector, Length
vec_2 = VectorXYZ(XComponent=0, YComponent=0, ZComponent=number_slider_2)  # -> Vector, Length
vec_3 = VectorXYZ(XComponent=0, YComponent=number_slider_3, ZComponent=0)  # -> Vector, Length
vec_4 = VectorXYZ(XComponent=0, YComponent=0, ZComponent=subtraction)  # -> Vector, Length
move = Move(Geometry=crv, Motion=vec.Vector)  # -> Geometry, Transform
move_2 = Move(Geometry=crv_2, Motion=vec_3.Vector)  # -> Geometry, Transform
xy = XYPlane(Origin=vec_4.Vector)
arrpolar = PolarArray(Geometry=move.Geometry, Plane=PlaneXY(0, 0, 0), Count=3, Angle=6.283185307)  # -> Geometry, Transform
arrpolar_2 = PolarArray(Geometry=move_2.Geometry, Plane=PlaneXY(0, 0, 0), Count=3, Angle=6.283185307)  # -> Geometry, Transform
vec_5 = VectorXYZ(XComponent=0, YComponent=0, ZComponent=Slider(5, range=0..10))  # -> Vector, Length
polygon = Polygon(Plane=xy, Radius=Slider(9, range=0..10), Segments=6, FilletRadius=0)  # -> Polygon, Length
extr = Extrude(Base=arrpolar.Geometry, Direction=vec_2.Vector)
rotate = Rotate(Geometry=polygon.Polygon, Angle=1.570796327, Plane=PlaneXY(0, 0, 0))  # -> Geometry, Transform
vec_6 = VectorXYZ(XComponent=0, YComponent=0, ZComponent=number_slider)  # -> Vector, Length
cyl = Cylinder(Base=PlaneXY(0, 0, 0), Radius=expr("x+2", number_slider_3), Length=vec_5.Vector)
extr_2 = Extrude(Base=arrpolar_2.Geometry, Direction=vec_5.Vector)
extr_3 = Extrude(Base=rotate.Geometry, Direction=vec_6.Vector)
cap = CapHoles(Brep=[extr_3, extr])
cap_2 = CapHoles(Brep=[extr_2, cyl])
sunion = SolidUnion(Breps=flatten(cap))
sunion_2 = SolidUnion(Breps=flatten(cap_2))
