# Grasshopper definition nested-boxes.gh (Grasshopper 1.0.7)

x_radius = Slider(10, range=5..50)
y_radius = Slider(10, range=5..50)
buildings = Slider(4, range=1..10)
height = Slider(50, range=10..100)
gap = Slider(4, range=2..10)
series = Series(Start=y_radius, Step=gap, Count=buildings)
series_2 = Series(Start=height, Step=2, Count=buildings)
series_3 = Series(Start=x_radius, Step=gap, Count=buildings)
vector_xyz = VectorXYZ(XComponent=expr("-x", series_3), YComponent=expr("-x", series), ZComponent=series_2)  # -> Vector, Length
vector_xyz_2 = VectorXYZ(XComponent=expr("x-1", series_3), YComponent=expr("x-1", series), ZComponent=0)  # -> Vector, Length
vector_xyz_3 = VectorXYZ(XComponent=expr("-(x-1)", series_3), YComponent=expr("-(x-1)", series), ZComponent=expr("x-1", series_2))  # -> Vector, Length
vector_xyz_4 = VectorXYZ(XComponent=series_3, YComponent=series, ZComponent=0)  # -> Vector, Length
box_2pt = Box2Pt(PointA=vector_xyz_4.Vector, PointB=vector_xyz.Vector, Plane=PlaneXY(0, 0, 0))
box_2pt_2 = Box2Pt(PointA=vector_xyz_2.Vector, PointB=vector_xyz_3.Vector, Plane=PlaneXY(0, 0, 0))
solid_difference = SolidDifference(BrepsA=box_2pt, BrepsB=box_2pt_2)
