# Grasshopper definition spin-things.gh (Grasshopper 1.0.7)

# ---- group: Making Spindles, Yo
column_height = Slider(24, range=0..100)
disk_height = Slider(1, range=0..10)
disk_radius = Slider(2, range=0..10)
number_slider = Slider(1, range=1..5)
column_radius = Slider(2, range=0..10)
series = Series(Start=column_radius, Step=number_slider, Count=Slider(6, range=0..10))
vec = VectorXYZ(XComponent=0, YComponent=0, ZComponent=expr("x/2", column_height))  # -> Vector, Length
vec_2 = VectorXYZ(XComponent=0, YComponent=0, ZComponent=expr("x/2", disk_height))  # -> Vector, Length
addition = Addition(A=series, B=disk_radius)
subtraction = Subtraction(A=vec.Vector, B=vec_2.Vector)
addition_2 = Addition(A=vec.Vector, B=vec_2.Vector)
item = ListItem(List=series, Index=expr("-1", 0), Wrap=True)
addition_3 = Addition(A=number_slider, B=disk_radius)
addition_4 = Addition(A=item, B=addition_3)
cone = Cone(Base=subtraction, Radius=addition, Length=expr("-x", addition))  # -> Cone, Tip
cyl = Cylinder(Base=subtraction, Radius=addition, Length=disk_height)
cyl_2 = Cylinder(Base=PlaneXY(0, 0, 0), Radius=addition_4, Length=column_height)
cyl_3 = Cylinder(Base=PlaneXY(0, 0, 0), Radius=series, Length=column_height)
cone_2 = Cone(Base=addition_2, Radius=addition, Length=addition)  # -> Cone, Tip
merge = Merge(Data1=graft(cyl_3), Data2=graft(cyl), Data3=graft(cone_2.Cone), Data4=graft(cone.Cone))

# ---- group: Grasshopper Version
cap = CapHoles(Brep=cyl_2)
cap_2 = CapHoles(Brep=merge)
sunion = SolidUnion(Breps=cap_2)
merge_2 = Merge(Data1=flatten(sunion), Data2=cap)
split = SplitList(List=flatten(merge_2), Index=1)  # -> ListA, ListB
item_2 = ListItem(List=split.ListA, Index=0, Wrap=True)
partition = PartitionList(List=split.ListB, Size=2)
item_3 = ListItem(List=partition, Index=0, Wrap=True)
item_4 = ListItem(List=partition, Index=1, Wrap=True)
sdiff = SolidDifference(BrepsA=item_4, BrepsB=item_3)
merge_3 = Merge(Data1=item_2, Data2=sdiff)

# ---- group: Python Version
python = GhPythonScript(x=merge, y=cyl_2)  # -> out, a; inputs x: tree
# ---------- python: Python ----------
import rhinoscriptsyntax as rs
import ghpythonlib.treehelpers as th

x = th.tree_to_list(x)

# cap and union the spindle parts
unions = []
for group in x[0]:
    for obj in group:
        rs.CapPlanarHoles(obj)
    unions.append(rs.BooleanUnion(group))

# cap and add the outer cylinder
rs.CapPlanarHoles(y)
unions.append(y)

# add the innermost spindle
objects = [unions[0]]

# use zip and slicing to fake a chunk function
# to split the remaining solids into pairs
# add the difference between the pairs
for pair in zip(unions[1::2], unions[2::2]):
    objects.append(rs.BooleanDifference(pair[1], pair[0]))

a = th.list_to_tree(objects)
# ---------- end python ----------
